# Grasshopper definition 20190522_KDS_modeling.gh (Grasshopper 1.0.7)

number_slider = Slider(100, range=0..10000)
number_slider_2 = Slider(40, range=0..1000)
number_slider_3 = Slider(180, range=0..1000)
number_slider_4 = Slider(81, range=0..1000)
division = Division(A="1", B=number_slider)
addition = Addition(A=number_slider, B="1")
multiplication = Multiplication(A=number_slider_4, B="-1")
multiplication_2 = Multiplication(A=Slider(48, range=0..1000), B="0.5")
series = Series(Start=0, Step=division, Count=addition)
vec = VectorXYZ(XComponent=0, YComponent=0, ZComponent=0)  # -> Vector, Length
vec_2 = VectorXYZ(XComponent=number_slider_4, YComponent=0, ZComponent=0)  # -> Vector, Length
vec_3 = VectorXYZ(XComponent=number_slider_3, YComponent=0, ZComponent=number_slider_2)  # -> Vector, Length
vec_4 = VectorXYZ(XComponent=multiplication, YComponent=0, ZComponent=0)  # -> Vector, Length
vec_5 = VectorXYZ(XComponent=0, YComponent=0, ZComponent=0)  # -> Vector, Length
vec_6 = VectorXYZ(XComponent=Slider(184, range=0..1000), YComponent=0, ZComponent=0)  # -> Vector, Length
vec_7 = VectorXYZ(XComponent=number_slider_3, YComponent=0, ZComponent=number_slider_2)  # -> Vector, Length
vec_8 = VectorXYZ(XComponent=Slider(-48, range=-1000..1000), YComponent=0, ZComponent=0)  # -> Vector, Length
bzspan = BezierSpan(StartPoint=vec.Vector, StartTangent=vec_2.Vector, EndPoint=vec_3.Vector, EndTangent=vec_4.Vector)  # -> Curve, Length, Domain
bzspan_2 = BezierSpan(StartPoint=vec_5.Vector, StartTangent=vec_6.Vector, EndPoint=vec_7.Vector, EndTangent=vec_8.Vector)  # -> Curve, Length, Domain
eval = EvaluateCurve(Curve=reparameterize(bzspan.Curve), Parameter=series)  # -> Point, Tangent, Angle
pdecon = Deconstruct(Point=eval.Point)  # -> XComponent, YComponent, ZComponent
vec_9 = VectorXYZ(XComponent=pdecon.XComponent, YComponent=0, ZComponent=0)  # -> Vector, Length
pt = Point(eval.Point)
ln = Line(StartPoint=eval.Point, EndPoint=vec_9.Vector)
clx = CurveLine(Curve=bzspan_2.Curve, Line=ln)  # -> flatten(Points), Params, Count
xz = XZPlane(Origin=Point(0, 0, 0))
pt_2 = Point(clx.Points)
pdecon_2 = Deconstruct(Point=clx.Points)  # -> XComponent, YComponent, ZComponent
subtraction = Subtraction(A=pdecon.ZComponent, B=pdecon_2.ZComponent)  # -> flatten(Result)
sort = SortList(Keys=subtraction)  # -> reverse(Keys), ValuesA
multiplication_3 = Multiplication(A=subtraction, B=Slider(0.559, range=0..1))
addition_2 = Addition(A=multiplication_3, B=pdecon_2.ZComponent)
item = ListItem(List=sort.Keys, Index="0", Wrap=True)
panel = Panel(subtraction)
nurbs = NurbsCurve(Degree=3, Periodic=False)  # -> Curve, Length, Domain
pt_3 = ConstructPoint(XCoordinate=pdecon.XComponent, YCoordinate=0, ZCoordinate=addition_2)
intcrv = Interpolate(Degree=3, Periodic=False, KnotStyle=1)  # -> Curve, Length, Domain
division_2 = Division(A=subtraction, B=item)
multiplication_4 = Multiplication(A=multiplication_2, B=division_2)
pt_4 = ConstructPoint(XCoordinate=pdecon.XComponent, YCoordinate=multiplication_4, ZCoordinate=addition_2)
mirror = Mirror(Geometry=pt_4, Plane=xz)  # -> Geometry, Transform
