# Grasshopper definition 20190523_KDS_modeling_ver02.gh (Grasshopper 1.0.7)

half_width = Slider(100, range=0..1000)
height_width = Slider(0.4, range=-5..5)
height_width_2 = Slider(0.5, range=-5..5)
number_slider = Slider(1000, range=0..10000)
number_slider_2 = Slider(1000, range=0..100000)
addition = Addition(A=number_slider, B="1")
division = Division(A=number_slider_2, B=number_slider)
addition_2 = Addition(A=number_slider, B="1")
division_2 = Division(A=number_slider_2, B=number_slider)
multiplication = Multiplication(A=height_width_2, B="-1")
multiplication_2 = Multiplication(A=Slider(0.022, range=0..1), B="-1")
multiplication_3 = Multiplication(A=Slider(0.6, range=0..1), B="-1")
series = Series(Start=0, Step=division, Count=addition)
multiplication_4 = Multiplication(A=Slider(0.75, range=0..10), B="-1")
multiplication_5 = Multiplication(A=Slider(0.217, range=0..1), B="-1")
series_2 = Series(Start=0, Step=division_2, Count=addition_2)
multiplication_6 = Multiplication(A=number_slider_2, B=Slider(0.333, range=0..1))
multiplication_7 = Multiplication(A=number_slider_2, B=Slider(0.016, range=0..1))
multiplication_8 = Multiplication(A=number_slider_2, B=multiplication_2)
multiplication_9 = Multiplication(A=half_width, B=height_width)
multiplication_10 = Multiplication(A=multiplication_9, B=Slider(1.5, range=0..10))
multiplication_11 = Multiplication(A=multiplication_9, B=Slider(0, range=0..1))
multiplication_12 = Multiplication(A=multiplication_11, B="-1")
multiplication_13 = Multiplication(A=half_width, B=multiplication)
multiplication_14 = Multiplication(A=multiplication_13, B=multiplication_4)
multiplication_15 = Multiplication(A=multiplication_13, B=multiplication_3)
multiplication_16 = Multiplication(A=multiplication_15, B="-1")
multiplication_17 = Multiplication(A=number_slider_2, B=Slider(0.283, range=0..1))
multiplication_18 = Multiplication(A=number_slider_2, B=Slider(0.241, range=0..1))
multiplication_19 = Multiplication(A=number_slider_2, B=multiplication_5)
multiplication_20 = Multiplication(A=number_slider_2, B=Slider(0.283, range=0..1))
vec = VectorXYZ(XComponent=multiplication_12, YComponent=0, ZComponent=0)  # -> Vector, Length
vec_2 = VectorXYZ(XComponent=0, YComponent=0, ZComponent=multiplication_9)  # -> Vector, Length
vec_3 = VectorXYZ(XComponent=multiplication_10, YComponent=0, ZComponent=0)  # -> Vector, Length
vec_4 = VectorXYZ(XComponent=half_width, YComponent=0, ZComponent=0)  # -> Vector, Length
vec_5 = VectorXYZ(XComponent=multiplication_16, YComponent=0, ZComponent=0)  # -> Vector, Length
vec_6 = VectorXYZ(XComponent=0, YComponent=0, ZComponent=multiplication_13)  # -> Vector, Length
vec_7 = VectorXYZ(XComponent=multiplication_14, YComponent=0, ZComponent=0)  # -> Vector, Length
vec_8 = VectorXYZ(XComponent=half_width, YComponent=0, ZComponent=0)  # -> Vector, Length
vec_9 = VectorXYZ(XComponent=0, YComponent=0, ZComponent=0)  # -> Vector, Length
vec_10 = VectorXYZ(XComponent=multiplication_6, YComponent=multiplication_7, ZComponent=0)  # -> Vector, Length
vec_11 = VectorXYZ(XComponent=0, YComponent=number_slider_2, ZComponent=0)  # -> Vector, Length
vec_12 = VectorXYZ(XComponent=0, YComponent=multiplication_8, ZComponent=0)  # -> Vector, Length
pt = ConstructPoint(XCoordinate=0, YCoordinate=series, ZCoordinate=0)
vec_13 = VectorXYZ(XComponent=0, YComponent=0, ZComponent=0)  # -> Vector, Length
vec_14 = VectorXYZ(XComponent=0, YComponent=multiplication_18, ZComponent=multiplication_17)  # -> Vector, Length
vec_15 = VectorXYZ(XComponent=0, YComponent=number_slider_2, ZComponent=multiplication_20)  # -> Vector, Length
vec_16 = VectorXYZ(XComponent=0, YComponent=0, ZComponent=multiplication_19)  # -> Vector, Length
multiplication_21 = Multiplication(A=half_width, B=Slider(5, range=0..100))
pt_2 = ConstructPoint(XCoordinate=multiplication_21, YCoordinate=series, ZCoordinate=0)
pt_3 = ConstructPoint(XCoordinate=0, YCoordinate=series_2, ZCoordinate=0)
multiplication_22 = Multiplication(A=half_width, B=Slider(5, range=0..100))
pt_4 = ConstructPoint(XCoordinate=0, YCoordinate=series_2, ZCoordinate=multiplication_22)
bzspan = BezierSpan(StartPoint=vec_2.Vector, StartTangent=vec_3.Vector, EndPoint=vec_4.Vector, EndTangent=vec.Vector)  # -> Curve, Length, Domain
bzspan_2 = BezierSpan(StartPoint=vec_6.Vector, StartTangent=vec_7.Vector, EndPoint=vec_8.Vector, EndTangent=vec_5.Vector)  # -> Curve, Length, Domain
bzspan_3 = BezierSpan(StartPoint=vec_9.Vector, StartTangent=vec_10.Vector, EndPoint=vec_11.Vector, EndTangent=vec_12.Vector)  # -> Curve, Length, Domain
ln = Line(StartPoint=pt, EndPoint=pt_2)
bzspan_4 = BezierSpan(StartPoint=vec_13.Vector, StartTangent=vec_14.Vector, EndPoint=vec_15.Vector, EndTangent=vec_16.Vector)  # -> Curve, Length, Domain
ln_2 = Line(StartPoint=pt_3, EndPoint=pt_4)
geo = Geometry([bzspan_2.Curve, bzspan.Curve])
mirror = Mirror(Geometry=bzspan_3.Curve, Plane=PlaneYZ(0, 0, 0))  # -> Geometry, Transform; disabled
join = JoinCurves(Curves=[mirror.Geometry, bzspan_3.Curve], Preserve=False)  # disabled
clx = CurveLine(Curve=bzspan_3.Curve, Line=ln)  # -> flatten(Points), Params, Count
clx_2 = CurveLine(Curve=bzspan_4.Curve, Line=ln_2)  # -> flatten(Points), Params, Count
mirror_2 = Mirror(Geometry=geo, Plane=PlaneYZ(0, 0, 0))  # -> Geometry, Transform
pdecon = Deconstruct(Point=clx.Points)  # -> XComponent, YComponent, ZComponent
pdecon_2 = Deconstruct(Point=clx_2.Points)  # -> XComponent, YComponent, ZComponent
join_2 = JoinCurves(Curves=[geo, mirror_2.Geometry], Preserve=False)
geo_2 = Geometry(join_2)
addition_3 = Addition(A=number_slider, B="1")
division_3 = Division(A=number_slider_2, B=number_slider)
pi = Pi(Factor=1)
series_3 = Series(Start=0, Step=division_3, Count=addition_3)
division_4 = Division(A=pi, B=number_slider_2)
multiplication_23 = Multiplication(A=division_4, B=series_3)
sin = Sine(Value=multiplication_23)
vec_17 = VectorXYZ(XComponent=0, YComponent=series_3, ZComponent=pdecon_2.ZComponent)  # -> Vector, Length
python = GhPythonScript(x=pdecon.XComponent, y=Slider(0.001, range=0..1))  # -> a
# ---------- python: Python ----------
__author__ = "Akihito TAKEUCHI"
__version__ = "2019.05.24"

import rhinoscriptsyntax as rs

if(x < y):
    a = y
else:
    a = x
# ---------- end python ----------
abs = Absolute(Value=sin)
material = CreateMaterial(Diffuse=RGB(255, 105, 180), Specular=RGB(255, 255, 255), Emission=RGB(0, 0, 0), Transparency=0, Shine=0)
division_5 = Division(A=python, B=half_width)
scale = Scale(Geometry=geo_2, Center=Point(0, 0, 0), Factor=division_5)  # -> Geometry, Transform
move = Move(Geometry=scale.Geometry, Motion=vec_17.Vector)  # -> Geometry, Transform
loft = Loft(Curves=move.Geometry, Options={Adjust=False, Closed=False, LoftEnds=0, LoftSimp=0, LoftType=0, Rebuild=10, Refit=0.01})
geo_3 = Geometry(loft)
preview = CustomPreview(
    Geometry=geo_3,
    Material={diffuse=RGB(221, 160, 221), emission=RGB(66, 48, 66), shine=0.5, specular=RGB(255, 255, 255), transparency=0})
